# Grasshopper definition Grid-Demo-Primate.gh (Grasshopper 0.9.56)
# plug-ins: Kangaroo Components, Primate1

pcomp = Decompose(System=PlaneXY(0, 0, 0))  # -> XComponent, YComponent, ZComponent
pcomp_2 = Decompose(System=PlaneXY(0, 0, 0))  # -> XComponent, YComponent, ZComponent
pt = PointXYZ(XComponent=0, YComponent=0, ZComponent=0, System=PlaneXY(0, 0, 0))
# The size of the grid squares is based off of a circle.  This is arbirtrary.
crv = Curve(<curve referenced from the Rhino model>)
timer = Timer(TimerInterval=20, Target=counter)
cen = Center(Arc=crv)  # -> Center, Radius
counter = Counter(Reset=True)
int = Integer(4)
multiplication = Multiplication(A=cen.Radius, B=int)
fingers = CountFingers(TFrame=counter)
palm = Palm(TFrame=counter)  # -> Position, Speed, Direction
int_2 = Integer(1)
round = Round(Number=palm.Speed)  # -> Nearest, Floor, Ceiling
panel = Panel(fingers)
max = Maximum(A=int_2, B=fingers)
panel_2 = Panel(palm.Speed)
int_3 = Integer(round.Nearest)
addition = Addition(A=int_3, B=Slider(9, range=1..19))
xz = XZPlane(Origin=Point(0, 0, 0))
sqrt = SquareRoot(Value=addition)
vec2pt = Vector2Pt(PointA=palm.Position, PointB=palm.Direction, Unitize=True)  # -> Vector, Length
vdis = VectorDisplay(Anchor=palm.Position, Vector=vec2pt.Vector)
recgrid = Rectangular(Plane=xz, SizeX=multiplication, SizeY=multiplication, ExtentX=sqrt, ExtentY=max)  # -> Cells, Points
